# Grasshopper definition 01-midPoint-constrctPlane-loft.ghx (Grasshopper 0.9.76)

crv = Curve(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)
crv_2 = Curve(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)
crv_3 = Curve(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)
crv_4 = Curve(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)
number_slider = Slider(10, range=1..10)
crv_5 = Curve(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)
crv_6 = Curve(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)
crv_7 = Curve(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)
number_slider_2 = Slider(80, range=0..100)
crv_8 = Curve(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)
crv_9 = Curve(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)
number_slider_3 = Slider(20, range=0..100)
crv_10 = Curve(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)
crv_11 = Curve(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)
crv_12 = Curve(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)
flip = FlipCurve(Curve=crv_2)  # -> Curve, Flag
number_slider_4 = Slider(20, range=0..100)
flip_2 = FlipCurve(Curve=crv_3)  # -> Curve, Flag
divide = DivideCurve(Curve=crv_11, Count=number_slider_2, Kinks=False)  # -> Points, Tangents, Parameters
flip_3 = FlipCurve(Curve=crv_9)  # -> Curve, Flag
flip_4 = FlipCurve(Curve=crv_6)  # -> Curve, Flag
divide_2 = DivideCurve(Curve=crv_10, Count=number_slider_2, Kinks=False)  # -> Points, Tangents, Parameters
number_slider_5 = Slider(40, range=0..100)
number_slider_6 = Slider(20, range=0..100)
divide_3 = DivideCurve(Curve=crv_12, Count=number_slider, Kinks=False)  # -> Points, Tangents, Parameters
flip_5 = FlipCurve(Curve=crv_8)  # -> Curve, Flag
divide_4 = DivideCurve(Curve=crv, Count=number_slider_3, Kinks=False)  # -> Points, Tangents, Parameters
divide_5 = DivideCurve(Curve=flip.Curve, Count=number_slider_3, Kinks=False)  # -> Points, Tangents, Parameters
ln = Line(StartPoint=divide.Points, EndPoint=divide_2.Points)
divide_6 = DivideCurve(Curve=flip_3.Curve, Count=number_slider, Kinks=False)  # -> Points, Tangents, Parameters
number_slider_7 = Slider(1, range=0..100)
divide_7 = DivideCurve(Curve=crv_5, Count=number_slider_6, Kinks=False)  # -> Points, Tangents, Parameters
divide_8 = DivideCurve(Curve=flip_4.Curve, Count=number_slider_6, Kinks=False)  # -> Points, Tangents, Parameters
xy = XYPlane(Origin=divide_6.Points)
len = Length(Curve=ln)
curvepoint = PointOnCurve(ln, parameter=0.5)
ln_2 = Line(StartPoint=divide_4.Points, EndPoint=divide_5.Points)
divide_9 = DivideCurve(Curve=crv_7, Count=number_slider_5, Kinks=False)  # -> Points, Tangents, Parameters
divide_10 = DivideCurve(Curve=flip_5.Curve, Count=number_slider_5, Kinks=False)  # -> Points, Tangents, Parameters
divide_11 = DivideCurve(Curve=flip_2.Curve, Count=number_slider_4, Kinks=False)  # -> Points, Tangents, Parameters
divide_12 = DivideCurve(Curve=crv_4, Count=number_slider_4, Kinks=False)  # -> Points, Tangents, Parameters
X = UnitX(Factor=1)
Z = UnitZ(Factor=1)
ln_3 = Line(StartPoint=divide_7.Points, EndPoint=divide_8.Points)
len_2 = Length(Curve=ln_2)
curvepoint_2 = PointOnCurve(ln_2, parameter=0.5)
vrot = Rotate(Vector=divide_6.Tangents, Axis=xy, Angle="0.5*pi*-1")
ln_4 = Line(StartPoint=divide_9.Points, EndPoint=divide_10.Points)
move = Move(Geometry=curvepoint, Motion=X)  # -> Geometry, Transform
split = SplitList(List=divide_11.Points, Index=number_slider_7)  # -> ListA, ListB
division = Division(A=len_2, B=Slider(2, range=0..10))
split_2 = SplitList(List=divide_12.Points, Index=number_slider_7)  # -> ListA, ListB
len_3 = Length(Curve=ln_3)
viewer = ParamViewer(divide_12.Points)
vdis = VectorDisplay(Anchor=divide_6.Points, Vector=vrot)
curvepoint_3 = PointOnCurve(ln_3, parameter=0.5)
range = Range(Domain=Domain(0, 1), Steps=number_slider_2)
move_2 = Move(Geometry=curvepoint_2, Motion=Z)  # -> Geometry, Transform
Z_2 = UnitZ(Factor=1)
pl_3pt = Plane3Pt(PointA=curvepoint, PointB=divide.Points, PointC=move.Geometry)
division_2 = Division(A=len, B="2")
line = LineSDL(Start=divide_6.Points, Direction=vrot, Length=Slider(100, range=0..100))
curvepoint_4 = PointOnCurve(ln_4, parameter=0.5)
panel = Panel(range)
ccx = CurveCurve(CurveA=crv_12, CurveB=line)  # -> flatten(Points), ParamsA, ParamsB
Z_3 = UnitZ(Factor=1)
division_3 = Division(A=len_3, B=Slider(2, range=0..10))
len_4 = Length(Curve=ln_4)
ln_5 = Line(StartPoint=split.ListB, EndPoint=split_2.ListB)
curvepoint_5 = PointOnCurve(ln_5, parameter=0.5)
move_3 = Move(Geometry=curvepoint_3, Motion=Z_2)  # -> Geometry, Transform
move_4 = Move(Geometry=curvepoint_4, Motion=Z_3)  # -> Geometry, Transform
graph = GraphMapper(range, x0=0, x1=1, y0=0, y1=1, container_name="Bezier", cpx=[0, 0.3202894926, 0.5985505581, 1], cpy=[0, 1, 1, 0])
division_4 = Division(A=len_4, B=Slider(2, range=0..10))
pl_3pt_2 = Plane3Pt(PointA=curvepoint_2, PointB=divide_4.Points, PointC=move_2.Geometry)
pl_3pt_3 = Plane3Pt(PointA=curvepoint_3, PointB=divide_7.Points, PointC=move_3.Geometry)
viewer_2 = ParamViewer(ln_5)
ln_6 = Line(StartPoint=divide_6.Points, EndPoint=ccx.Points)
pl_3pt_4 = Plane3Pt(PointA=curvepoint_4, PointB=divide_9.Points, PointC=move_4.Geometry)
len_5 = Length(Curve=ln_6)
panel_2 = Panel(len_5)
cir = Circle(Plane=pl_3pt_2, Radius=division)
Z_4 = UnitZ(Factor=1)
curvepoint_6 = PointOnCurve(ln_6, parameter=0.5)
xz = XZPlane(Origin=Point(0, 0, 0))
Z_5 = UnitZ(Factor=1)
division_5 = Division(A=len_5, B="2")
cir_2 = Circle(Plane=pl_3pt_3, Radius=division_3)
loft = Loft(Curves=cir, Options={Adjust=False, Closed=False, LoftEnds=0, LoftSimp=0, LoftType=0, Rebuild=10, Refit=0.01})
len_6 = Length(Curve=ln_5)
remap = RemapNumbers(Value=graph, Source="0 to 1", Target="0.1 to 5.5")  # -> Mapped, Clipped
move_5 = Move(Geometry=curvepoint_5, Motion=Z_4)  # -> Geometry, Transform
cir_3 = Circle(Plane=pl_3pt_4, Radius=division_4)
move_6 = Move(Geometry=curvepoint_6, Motion=Z_5)  # -> Geometry, Transform
mirror = Mirror(Geometry=loft, Plane=xz)  # -> Geometry, Transform
division_6 = Division(A=len_6, B="2")
loft_2 = Loft(Curves=cir_2, Options={Adjust=False, Closed=False, LoftEnds=0, LoftSimp=0, LoftType=0, Rebuild=10, Refit=0.01})
panel_3 = Panel(remap.Mapped)
crv_13 = Curve([cir_2, cir_3])
yz = YZPlane(Origin=Point(0, 0, 0))
merge = Merge(Data1=mirror.Geometry, Data2=loft)
pl_3pt_5 = Plane3Pt(PointA=curvepoint_6, PointB=divide_6.Points, PointC=move_6.Geometry)
pl_3pt_6 = Plane3Pt(PointA=curvepoint_5, PointB=split_2.ListB, PointC=move_5.Geometry)
loft_3 = Loft(Curves=cir_3, Options={Adjust=False, Closed=False, LoftEnds=0, LoftSimp=0, LoftType=0, Rebuild=10, Refit=0.01})
ellipse = Ellipse(Plane=pl_3pt, Radius1=division_2, Radius2=remap.Mapped)  # -> Ellipse, Focus1, Focus2
viewer_3 = ParamViewer(remap.Mapped)
move_7 = Move(Geometry=crv_13, Motion="60,0,0")  # -> Geometry, Transform
mirror_2 = Mirror(Geometry=loft_2, Plane=yz)  # -> Geometry, Transform
cir_4 = Circle(Plane=pl_3pt_5, Radius=division_5)
cir_5 = Circle(Plane=pl_3pt_6, Radius=division_6)
loft_4 = Loft(Curves=ellipse.Ellipse, Options={Adjust=False, Closed=False, LoftEnds=0, LoftSimp=0, LoftType=0, Rebuild=10, Refit=0.01})
merge_2 = Merge(Data1=loft_2, Data2=mirror_2.Geometry, Data3=loft_3)
capex = CapHolesEx(Brep=loft_4)  # -> Brep, Caps, Solid
panel_4 = Panel(capex.Brep)
loft_5 = Loft(Curves=cir_4, Options={Adjust=False, Closed=False, LoftEnds=0, LoftSimp=0, LoftType=0, Rebuild=10, Refit=0.01})
loft_6 = Loft(Curves=cir_5, Options={Adjust=False, Closed=False, LoftEnds=0, LoftSimp=0, LoftType=0, Rebuild=10, Refit=0.01})
capex_2 = CapHolesEx(Brep=merge)  # -> Brep, Caps, Solid
brep = Brep(capex.Brep)
brep_2 = Brep(loft_5)
brep_3 = Brep(loft_6)
brep_4 = Brep(merge_2)
move_8 = Move(Geometry=brep_4, Motion="60,0,0")  # -> Geometry, Transform
