# Grasshopper definition 02-3D-Surface.ghx (Grasshopper 0.9.76)

crv = Curve(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)
crv_2 = Curve(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)
divide = DivideCurve(Curve=crv, Count=Slider(150, range=10..200), Kinks=False)  # -> Points, Tangents, Parameters
divide_2 = DivideCurve(Curve=crv_2, Count=Slider(150, range=10..200), Kinks=False)  # -> Points, Tangents, Parameters
intcrv = Interpolate(Vertices=divide.Points, Degree=3, Periodic=Toggle(True), KnotStyle=1)  # -> Curve, Length, Domain
intcrv_2 = Interpolate(Vertices=divide_2.Points, Degree=3, Periodic=Toggle(True), KnotStyle=1)  # -> Curve, Length, Domain
crv_3 = Curve(crv)
crv_4 = Curve(crv_2)
boundary = BoundarySurfaces(Edges=crv_3)
boundary_2 = BoundarySurfaces(Edges=crv_4)
area = Area(Geometry=boundary)  # -> Area, Centroid
area_2 = Area(Geometry=boundary_2)  # -> Area, Centroid
divide_3 = DivideCurve(Curve=crv_3, Count=Slider(400, range=10..500), Kinks=False)  # -> Points, Tangents, Parameters
divide_4 = DivideCurve(Curve=crv_4, Count=Slider(400, range=10..500), Kinks=False)  # -> Points, Tangents, Parameters
dist = Distance(PointA=area.Centroid, PointB=divide_3.Points)
dist_2 = Distance(PointA=area_2.Centroid, PointB=divide_4.Points)
bnd = Bounds(Numbers=dist)
bnd_2 = Bounds(Numbers=dist_2)
remap = RemapNumbers(Value=dist, Source=bnd, Target="20 To 0")  # -> Mapped, Clipped
remap_2 = RemapNumbers(Value=dist_2, Source=bnd_2, Target="20 to 0")  # -> Mapped, Clipped
Z = UnitZ(Factor=remap.Mapped)
Z_2 = UnitZ(Factor=remap_2.Mapped)
move = Move(Geometry=divide_3.Points, Motion=Z)  # -> Geometry, Transform
move_2 = Move(Geometry=divide_4.Points, Motion=Z_2)  # -> Geometry, Transform
intcrv_3 = Interpolate(Vertices=move.Geometry, Degree=3, Periodic=Toggle(True), KnotStyle=1)  # -> Curve, Length, Domain
intcrv_4 = Interpolate(Vertices=move_2.Geometry, Degree=3, Periodic=Toggle(True), KnotStyle=1)  # -> Curve, Length, Domain
patch = Patch(Curves=intcrv_3.Curve, Spans=20, Flexibility=1, Trim=True)
patch_2 = Patch(Curves=intcrv_4.Curve, Spans=20, Flexibility=1, Trim=True)
extr = Extrude(Base=patch, Direction="0,0,-1.5")
extr_2 = Extrude(Base=patch_2, Direction="0,0,-1.5")
