# Grasshopper definition 03-pipeVariable-range.ghx (Grasshopper 0.9.76)

number_slider = Slider(20, range=0..100)
number_slider_2 = Slider(50, range=0..100)
crv = Curve(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)
crv_2 = Curve(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)
divide = DivideCurve(Curve=crv, Count=number_slider, Kinks=False)  # -> Points, Tangents, Parameters
divide_2 = DivideCurve(Curve=crv_2, Count=number_slider_2, Kinks=False)  # -> Points, Tangents, Parameters
range = Range(Domain=Domain(0, 1), Steps=number_slider)
range_2 = Range(Domain=Domain(0, 1), Steps=number_slider_2)
vdis = VectorDisplay(Anchor=divide.Points, Vector=divide.Tangents)
graph = GraphMapper(range, x0=0, x1=1, y0=0, y1=1, container_name="Bezier", cpx=[0, 0.3048276603, 0.7108962536, 1], cpy=[0, 1, 1, 0])
vdis_2 = VectorDisplay(Anchor=divide_2.Points, Vector=divide_2.Tangents)
graph_2 = GraphMapper(
    range_2,
    x0=0,
    x1=1,
    y0=0,
    y1=1,
    amplitude=0.4929405451,
    container_name="Perlin",
    decay=1,
    frequency=0.379586041,
    x_offset=0.4162757695,
    y_offset=0.4352946281)
remap = RemapNumbers(Value=graph, Source="0 to 1", Target="0.2 to 6")  # -> Mapped, Clipped
remap_2 = RemapNumbers(Value=graph_2, Source="0 to 1", Target="1 to 7.5")  # -> Mapped, Clipped
vpipe = PipeVariable(Curve=crv, Parameters=divide.Parameters, Radii=remap.Mapped, Caps=0)
vpipe_2 = PipeVariable(Curve=crv_2, Parameters=divide_2.Parameters, Radii=remap_2.Mapped, Caps=0)
